# Grasshopper definition Envelope_mmalani.gh (Grasshopper 1.0.7)
# plug-ins: Heliotrope, Kangaroo2 Components

# ---- group: SUN'S POSITION
distance_from_facade = Slider(-70, range=-70..10)
day = Slider(104, range=0..200)
hours = Slider(0.29, range=0..1)

# ---- group: SURFACE DIVISION
number_slider = Slider(6, range=1..30)
number_slider_2 = Slider(6, range=1..30)

# ---- group: DRIVE SURFACE
srf = Surface(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)

# ---- group: BASE SURFACE DIVISION
python_surface_panels = GhPythonScript(surface=srf, uCount=number_slider_2, vCount=number_slider)  # -> out, panels; inputs surface: Surface, uCount: Int32, vCount: Int32
# ---------- python_surface_panels: Python ----------
import ghpythonlib.components as ghcomp

# Reparameterize surface
newDom = ghcomp.ConstructDomain(0,1)
surface.SetDomain(0,newDom)
surface.SetDomain(1,newDom)


# Sub-surfaces from input surface
panels =[]
# Panel width and height
## Divide U & V domains by number of surface panels in U & V directions
uInc, vInc =1/uCount, 1/vCount 

# Trim panels from input surface 
for uStep in range(uCount):
    uMin,uMax = uStep*uInc, uStep*uInc+uInc
    for vStep in range(vCount): 
        vMin,vMax = vStep*vInc, vStep*vInc+vInc
        panelDomain = ghcomp.ConstructDomain2(uMin, uMax, vMin, vMax)
        panel = ghcomp.Isotrim(surface, panelDomain)
        panels.append(panel)
# ---------- end python_surface_panels ----------
sframes = SurfaceFrames(Surface=srf, UCount=number_slider_2, VCount=number_slider)  # -> Frames, Parameters

# ---- group: TRIANGLES ON THE SURFACE
debrep = DeconstructBrep(Brep=python_surface_panels.panels)  # -> Faces, Edges, Vertices
item = ListItem(List=debrep.Vertices, Index="1", Wrap=True)
item_2 = ListItem(List=debrep.Vertices, Index="0", Wrap=True)
item_3 = ListItem(List=debrep.Vertices, Index="3", Wrap=True)
item_4 = ListItem(List=debrep.Vertices, Index="2", Wrap=True)
number_slider_3 = Slider(0.25, range=0..1)
srf4pt = _4PointSurface(CornerA=item_2, CornerB=item, CornerC=item_4)  # -> simplify(Surface)
srf4pt_2 = _4PointSurface(CornerA=item_2, CornerB=item_4, CornerC=item_3)
offset = OffsetCurve(Curve=srf4pt, Distance=expr("-x", number_slider_3), Corners=1)
offset_2 = OffsetCurve(Curve=srf4pt_2, Distance=expr("-x", number_slider_3), Corners=1)
crv = Curve([offset, offset_2])

# ---- group: SPIDER CONNECTION
number_slider_4 = Slider(0.1, range=0..1)
subtraction = Subtraction(A="1", B=number_slider_4)
deplane = DeconstructPlane(Plane=sframes.Frames)  # -> Origin, XAxis, YAxis, ZAxis
panel = Panel("""{0},{0}
{1},{1}
{0},{1}
{1},{0}""")
format = Format(Format=panel, Culture=127, Data0=number_slider_4, Data1=subtraction)
panel_2 = Panel("""0,0
1,1
0,1
1,0""")
number_slider_5 = Slider(1.8, range=0.5..15)
evalsrf = EvaluateSurface(Surface=reparameterize(python_surface_panels.panels), Point=graft(format))  # -> Point, Normal, UDirection, VDirection, Frame
evalsrf_2 = EvaluateSurface(Surface=reparameterize(python_surface_panels.panels), Point=graft(panel_2))  # -> Point, Normal, UDirection, VDirection, Frame
amp = Amplitude(Vector=evalsrf_2.Normal, Amplitude=number_slider_5)
number_slider_6 = Slider(1, range=0.1..10)
amp_2 = Amplitude(Vector=evalsrf.Normal, Amplitude=expr("x*-1", Slider(0.5, range=0..1)))
amp_3 = Amplitude(Vector=deplane.ZAxis, Amplitude=number_slider_5)
circle = CircleCNR(Center=evalsrf.Point, Normal=evalsrf.Normal, Radius=Slider(0.5, range=0.5..10))  # -> graft(Circle)
move = Move(Geometry=evalsrf_2.Point, Motion=amp)  # -> Geometry, Transform
extr = Extrude(Base=circle, Direction=graft(amp_2))
circle_2 = CircleCNR(Center=move.Geometry, Normal=evalsrf_2.Normal, Radius=number_slider_6)  # -> graft(Circle)
move_2 = Move(Geometry=sframes.Frames, Motion=amp_3)  # -> Geometry, Transform
cap = CapHoles(Brep=extr)
sph = Sphere(Base=move_2.Geometry, Radius=number_slider_6)
loft = Loft(
    Curves=[circle_2, circle],
    Options={Adjust=False, Closed=False, LoftEnds=0, LoftSimp=0, LoftType=0, Rebuild=10, Refit=0.01})

# ---- group: SURFACE NORMALS
area = Area(Geometry=[srf4pt, srf4pt_2])  # -> Area, Centroid
srf_cp = SurfaceClosestPoint(Point=area.Centroid, Surface=[srf4pt, srf4pt_2])  # -> Point, UVPoint, Distance
evalsrf_3 = EvaluateSurface(Surface=[srf4pt, srf4pt_2], Point=srf_cp.UVPoint)  # -> Point, Normal, UDirection, VDirection, Frame
line = LineSDL(Start=evalsrf_3.Point, Direction=evalsrf_3.Normal, Length=Slider(-10, range=-10..10))

# ---- group: TRIANGLE FRAME
offset_3 = OffsetCurve(Curve=crv, Distance=expr("-x", number_slider_3), Corners=1)
offset_4 = OffsetCurve(Curve=crv, Distance=number_slider_3, Corners=1)
loft_2 = Loft(
    Curves=[offset_4, offset_3],
    Options={Adjust=False, Closed=False, LoftEnds=0, LoftSimp=0, LoftType=0, Rebuild=10, Refit=0.01})
amp_4 = Amplitude(Vector=evalsrf_3.Normal, Amplitude=number_slider_3)
extr_2 = Extrude(Base=loft_2, Direction=amp_4)

# ---- group: TRIANGLE FINS VERTICES
Y = UnitY(Factor=1)
area_2 = Area(Geometry=crv)  # -> Area, Centroid
explode = Explode(Curve=crv, Recursive=True)  # -> Segments, Vertices
neg = Negative(Value=Y)
item_5 = ListItem(List=explode.Segments, Index=0, Wrap=True)  # -> Item, Item1, Item2
line_2 = LineSDL(Start=area_2.Centroid, Direction=neg, Length=Slider(3, range=0..100))
curvepoint = PointOnCurve([item_5.Item, item_5.Item1, item_5.Item2], parameter=1)
curvepoint_2 = PointOnCurve([item_5.Item, item_5.Item1, item_5.Item2], parameter=0)
item_6 = ListItem(List=curvepoint, Index=0, Wrap=True)  # -> Item, Item1, Item2
item_7 = ListItem(List=curvepoint_2, Index=0, Wrap=True)  # -> Item, Item1, Item2
end = EndPoints(Curve=line_2)  # -> Start, End

# ---- group: STRUCTURAL SUPPORT
number_slider_7 = Slider(2.2, range=0..10)
flip = FlipMatrix(Data=sframes.Frames)
deplane_2 = DeconstructPlane(Plane=flip)  # -> Origin, XAxis, YAxis, ZAxis
addition = Addition(A=number_slider_5, B=number_slider_7)
addition_2 = Addition(A=addition, B=Slider(3, range=0..10))
amp_5 = Amplitude(Vector=amp_3, Amplitude=number_slider_7)
amp_6 = Amplitude(Vector=deplane_2.ZAxis, Amplitude=addition)
amp_7 = Amplitude(Vector=deplane_2.ZAxis, Amplitude=addition_2)
move_3 = Move(Geometry=move_2.Geometry, Motion=amp_5)  # -> Geometry, Transform
move_4 = Move(Geometry=deplane_2.Origin, Motion=amp_7)  # -> Geometry, Transform
move_5 = Move(Geometry=deplane_2.Origin, Motion=amp_6)  # -> Geometry, Transform
ln = Line(StartPoint=move_2.Geometry, EndPoint=move_3.Geometry)
pline = PolyLine(Vertices=move_5.Geometry, Closed=False)
pline_2 = PolyLine(Vertices=move_4.Geometry, Closed=False)
pline_3 = PolyLine(Vertices=move_3.Geometry, Closed=False)
panel_3 = Panel(""".6
.3""")
panel_4 = Panel("""{0;1}[1]
{0;1}[-1]""")
divide = DivideCurve(Curve=[pline, pline_2], Count=Slider(20, range=0..100), Kinks=False)  # -> simplify(Points), Tangents, Parameters
panel_5 = Panel("""0
1""")
relitem = RelativeItem(Tree=divide.Points, Offset=panel_4, WrapPaths=False, WrapItems=False)  # -> ItemA, ItemB
vpipe = PipeVariable(Curve=ln, Parameters=panel_5, Radii=panel_3, Caps=0)
ln_2 = Line(StartPoint=relitem.ItemA, EndPoint=relitem.ItemB)
mp = MultiPipe(
    Curves=[pline, pline_2, ln_2],
    NodeSize=0.5,
    EndOffset=1,
    StrutSize=Slider(0.5, range=0..1),
    Segment=Slider(1, range=0..1),
    KinkAngle=0.6,
    CubeFit=0,
    Caps=2)

# ---- group: FINS
ln_3 = Line(StartPoint=item_7.Item, EndPoint=end.End)
ln_4 = Line(StartPoint=item_7.Item, EndPoint=item_6.Item)
ln_5 = Line(StartPoint=item_6.Item, EndPoint=end.End)
join = JoinCurves(Curves=[ln_4, ln_5, ln_3], Preserve=False)

ln_6 = Line(StartPoint=item_7.Item1, EndPoint=item_6.Item1)
ln_7 = Line(StartPoint=item_7.Item1, EndPoint=end.End)
ln_8 = Line(StartPoint=item_6.Item1, EndPoint=end.End)
join_2 = JoinCurves(Curves=[ln_6, ln_7, ln_8], Preserve=False)

ln_9 = Line(StartPoint=item_7.Item2, EndPoint=item_6.Item2)
ln_10 = Line(StartPoint=item_7.Item2, EndPoint=end.End)
ln_11 = Line(StartPoint=item_6.Item2, EndPoint=end.End)
join_3 = JoinCurves(Curves=[ln_9, ln_10, ln_11], Preserve=False)

# ---- group: FIN EDGEE FILLET
fillet = Slider(0, range=0..0.5)
fillet_2 = Fillet(Curve=[join, join_2, join_3], Radius=fillet)

# ---- group: SPIDER CLIP
join_4 = BrepJoin(Breps=[cap, loft, sph, vpipe])  # -> Breps, Closed

# ---- group: SUN
area_3 = Area(Geometry=srf)  # -> Area, Centroid
solar_arc = SolarArc(
    JulianDay=day,
    Latitude="40.4406",
    Longitude="79.9959",
    North=Vector(0, 1, 0),
    Origin=Point(0, 0, 0),
    ScaleArc=Slider(70, range=0..100),
    ScaleSun=Slider(2, range=0..10),
    Offset=hours)  # -> SolarArc, Sun, SolarVector, TimeOfDay
X = UnitX(Factor=area_3.Centroid)
move_6 = Move(Geometry=[solar_arc.SolarArc, solar_arc.Sun], Motion=X)  # -> Geometry, Transform
Y_2 = UnitY(Factor=distance_from_facade)
move_7 = Move(Geometry=move_6.Geometry, Motion=Y_2)  # -> Geometry, Transform
item_8 = ListItem(List=move_7.Geometry, Index=0, Wrap=True)  # -> Item, Item1

# ---- group: SUN / Arc
crv_2 = Curve(item_8.Item)

# ---- group: SUN / Sun
srf_2 = Surface(item_8.Item1)

# ---- group: SUN (continued)
pipe = Pipe(Curve=crv_2, Radius=Slider(0.4, range=0..1), Caps=0)
volume = Volume(Geometry=srf_2)  # -> Volume, Centroid
pt = Point(volume.Centroid)

# ---- group: SUN INCIDENCE ANGLE
vec2pt = Vector2Pt(PointA=pt, PointB=evalsrf_3.Point, Unitize=False)  # -> Vector, Length
angle = Angle(VectorA=vec2pt.Vector, VectorB=evalsrf_3.Normal)  # -> Angle, Reflex
vdis = VectorDisplay(Anchor=evalsrf_3.Point, Vector=line)
vdis_2 = VectorDisplay(Anchor=pt, Vector=vec2pt.Vector)
neg_2 = Negative(Value=angle.Angle)

# ---- group: FIN COLOR
flatten = FlattenTree(Tree=neg_2, Path="{0}")
abs = Absolute(Value=flatten)
bnd = Bounds(Numbers=abs)
dedomain = DeconstructDomain(Domain=bnd)  # -> Start, End
gradient = Gradient(
    LowerLimit=dedomain.Start,
    UpperLimit=dedomain.End,
    Parameter=abs,
    stops=[0.278: RGB(0, 98, 0), 0.641: RGB(81, 175, 17), 0.912: RGB(170, 235, 41), 1: RGB(221, 255, 53)])

# ---- group: ROTATED FINS
item_9 = ListItem(List=fillet_2, Index=0, Wrap=True)  # -> Item, Item1, Item2
rotax = RotateAxis(Geometry=item_9.Item, Angle=expr("x/2", neg_2), Axis=item_5.Item)  # -> Geometry, Transform
rotax_2 = RotateAxis(Geometry=item_9.Item1, Angle=expr("x/2", neg_2), Axis=item_5.Item1)  # -> Geometry, Transform
rotax_3 = RotateAxis(Geometry=item_9.Item2, Angle=expr("x/2", neg_2), Axis=item_5.Item2)  # -> Geometry, Transform
boundary = BoundarySurfaces(Edges=rotax.Geometry)
boundary_2 = BoundarySurfaces(Edges=rotax_2.Geometry)
boundary_3 = BoundarySurfaces(Edges=rotax_3.Geometry)
join_5 = BrepJoin(Breps=[boundary, boundary_2, boundary_3])  # -> Breps, Closed

# ---- group: FINAL GEOMETRY
wire = CustomPreview(Geometry=mp, Material=ColourSwatch(SwatchColor=RGB(201, 197, 197)))
glass = CustomPreview(Geometry=python_surface_panels.panels, Material=ColourSwatch(SwatchColor=RGBA(94, 188, 214, 91)))
metal_hardware = CustomPreview(Geometry=join_4.Breps, Material=ColourSwatch(SwatchColor=RGB(140, 139, 139)))
preview = CustomPreview(Geometry=join_5.Breps, Shader=gradient)
preview_2 = CustomPreview(Geometry=join_5.Breps, Shader=gradient)
preview_3 = CustomPreview(Geometry=join_5.Breps, Shader=gradient)
metal_hardware_2 = CustomPreview(Geometry=extr_2, Material=ColourSwatch(SwatchColor=RGB(99, 98, 98)))

# ---- group: FINAL GEOMETRY / SUN ARC
preview_4 = CustomPreview(Geometry=pipe, Shader=ColourSwatch(SwatchColor=RGBA(194, 194, 194, 247)))

# ---- group: FINAL GEOMETRY / SUN
preview_5 = CustomPreview(Geometry=srf_2, Shader=ColourSwatch(SwatchColor=RGBA(217, 155, 102, 232)))
