# Grasshopper definition Modular-Array_mmalani.gh (Grasshopper 1.0.7)

# ---- group: Geometry_ControlParameters
box_scale = Slider(0.502, range=0.2..1)

# ---- group: Grid_ControlParameters
# Lisa Malani
x = Slider(6, range=1..50)
y = Slider(12, range=1..50)
z = Slider(5, range=1..50)
step = Slider(2, range=1..10)

# ---- group: 3D Array
python = GhPythonScript(length=x, width=y, height=z, step=step)  # -> out, outL, outW, outH, arrayPts, box; inputs length: Int32, width: Int32, height: Int32
# ---------- python: Python ----------
import ghpythonlib.components as ghc

## Initialize variables as empty lists
arrayPts = []
points = []
box = []
arrayBox = []

## Create Arry Point within nested for loop
for i in range(length):
    for j in range(width):
        for k in range(height):
            points = ghc.ConstructPoint(i*step, j*step, k*step)
            arrayPts.append(points)
            plane = ghc.XYPlane(arrayPts)
            box = ghc.CenterBox(plane,1,1,1)
            arrayBox.append(box)
## Out values
outL = (length-1)*step
outW = (width-1)*step
outH = (height-1)*step
# ---------- end python ----------

# ---- group: Randomisation
python_2 = GhPythonScript(boxScale=box_scale)  # -> out, boxRotation, attractors
# ---------- python_2: Python ----------
import random

## Randomization for the 3D geometry

## Initial stage with no geometric alteration
if boxScale == 1.00:
    boxRotation = 0
    attractors = 1

## Geometric alterations for scale below 1
## Random no. of attractor points generation
elif boxScale < 1.00:
    boxRotation = random.uniform(0.00, 180.00)
    attractors = random.uniform(2, 20)
# ---------- end python_2 ----------

# ---- group: Attractor Points
rectangle = Rectangle(Plane=PlaneXY(0, 0, 0), XSize=python.outL, YSize=python.outW, Radius=0)  # -> Rectangle, Length
boxrec = BoxRectangle(Rectangle=rectangle.Rectangle, Height=python.outH)
pop3d = Populate3D(Region=boxrec, Count=python_2.attractors, Seed="3", Points=Point(0, 0, 0))

# ---- group: Scaled Geometry
scale = Scale(Geometry=python.box, Center=python.arrayPts, Factor=box_scale)  # -> Geometry, Transform

# ---- group: Closest Points - Remapped
cp = ClosestPoint(Point=python.arrayPts, Cloud=pop3d)  # -> ClosestPoint, CPIndex, Distance
bnd = Bounds(Numbers=cp.Distance)
remap = RemapNumbers(Value=cp.Distance, Source=bnd, Target=Domain(0, 1))  # -> Mapped, Clipped

# ---- group: Color Conditional
larger = LargerThan(FirstNumber=python_2.attractors, SecondNumber="10")  # -> LargerThan, OrEqualTo
gate = StreamGate(Stream=remap.Mapped, Gate=larger.OrEqualTo)  # -> Target0, Target1

# ---- group: 3D Object Rotation
multiplication = Multiplication(A=python_2.boxRotation, B=cp.Distance)
vec2pt = Vector2Pt(PointA=python.arrayPts, PointB=pop3d, Unitize=False)  # -> Vector, Length
rot3d = Rotate3D(Geometry=scale.Geometry, Angle=degrees(multiplication), Center=python.arrayPts, Axis=vec2pt.Vector)  # -> Geometry, Transform

# ---- group: Color
gradient = Gradient(
    LowerLimit=0,
    UpperLimit=1,
    Parameter=gate.Target1,
    stops=[0: RGB(0, 98, 0), 0.25: RGB(81, 175, 17), 0.5: RGB(159, 198, 146), 0.75: RGB(170, 235, 41)])
gradient_2 = Gradient(LowerLimit=0, UpperLimit=1, Parameter=gate.Target0, stops=[0.15: RGB(255, 130, 160), 0.85: RGB(220, 0, 40)])
preview = CustomPreview(Geometry=rot3d.Geometry, Material=[gradient_2, gradient])
