# Grasshopper definition Parametric-Truss_mmalani.gh (Grasshopper 1.0.7)

truss_height_factor = Slider(0.747, range=0.5..1)
no_of_trusses = Slider(8, range=0..10)

# ---- group: Member Design
member_slope = Slider(0.2, range=-0.2..0.2)
connection_point = Slider(0.06, range=0..0.1)
no_of_tertiary_divisions = Slider(20, range=10..25)

# ---- group: Primay Member - Cross section
number_slider = Slider(0.03, range=0.02..0.1)
polygon = Polygon(Plane=PlaneXY(0, 0, 0), Radius=number_slider, Segments=Slider(9, range=0..10), FilletRadius=0)  # -> Polygon, Length

# ---- group: RailCrvs
rail_1 = Curve(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)
rail_2 = Curve(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)

# ---- group: Truss Height proportion
curvepoint = PointOnCurve(rail_2, parameter=0.5)
curvepoint_2 = PointOnCurve(rail_1, parameter=0.5)
dist = Distance(PointA=curvepoint_2, PointB=curvepoint)
multiplication = Multiplication(A=dist, B=truss_height_factor)

# ---- group: Primary Members / Member Depth
len = Length(Curve=rail_1)
division = Division(A=len, B=no_of_trusses)
division_2 = Division(A=division, B="1.5")

# ----
divide = DivideCurve(Curve=rail_2, Count=no_of_trusses, Kinks=False)  # -> Points, Tangents, Parameters
divide_2 = DivideCurve(Curve=rail_1, Count=no_of_trusses, Kinks=False)  # -> Points, Tangents, Parameters
subtraction = Subtraction(A="1", B=connection_point)
subtraction_2 = Subtraction(A="1", B=connection_point)
colour = ColourPicker(PickedColour=RGBA(166, 159, 159, 148))

# ---- group: Primary Members
ln = Line(StartPoint=divide_2.Points, EndPoint=divide.Points)
pframe = PerpFrame(Curve=reparameterize(ln), Parameter="0.5")
deplane = DeconstructPlane(Plane=pframe)  # -> Origin, XAxis, YAxis, ZAxis
amp = Amplitude(Vector=deplane.XAxis, Amplitude=multiplication)
move = Move(Geometry=deplane.Origin, Motion=amp)  # -> Geometry, Transform
weave = Weave(
    Pattern=[0, 1, 2],
    Stream0=graft(divide_2.Points),
    Stream1=graft(move.Geometry),
    Stream2=graft(divide.Points),
    NullGaps=False)

# ---- group: Primary Members / Member Slope
Y = UnitY(Factor=division_2)
neg = Negative(Value=Y)
Z = UnitZ(Factor=member_slope)
move_2 = Move(Geometry=move.Geometry, Motion=neg)  # -> Geometry, Transform
move_3 = Move(Geometry=move_2.Geometry, Motion=Z)  # -> Geometry, Transform

# ---- group: Primary Members (continued)
weave_2 = Weave(
    Pattern=[0, 1, 2],
    Stream0=graft(divide_2.Points),
    Stream1=graft(move_3.Geometry),
    Stream2=graft(divide.Points),
    NullGaps=False)

# ---- group: Primary Members / Top Curve 1
intcrv = Interpolate(Vertices=weave, Degree=3, Periodic=False, KnotStyle=1)  # -> Curve, Length, Domain

# ---- group: Primary Members / Top Curve 2
intcrv_2 = Interpolate(Vertices=weave_2, Degree=3, Periodic=False, KnotStyle=1)  # -> Curve, Length, Domain

# ----
simplify = SimplifyTree(Tree=intcrv_2.Curve, Front=False)  # -> flatten(Tree)
simplify_2 = SimplifyTree(Tree=intcrv.Curve, Front=False)  # -> flatten(Tree)

# ---- group: Secondary members
python = GhPythonScript(x=simplify, y=simplify_2, segments=no_of_tertiary_divisions)  # -> out, a, b, ptsX, ptsY; inputs x: tree of Curve, y: tree of Curve, segments: Int32
# ---------- python: Python ----------
import ghpythonlib.components as ghcomp
import ghpythonlib.treehelpers as ghtree
import Rhino.Geometry as rg

x = ghtree.tree_to_list(x)
x.pop(0)

y = ghtree.tree_to_list(y)
y.pop(-1)

#ptsX = ghcomp.DivideCurve(x, segments, True)[0]
#ptsY = ghcomp.DivideCurve(y, segments, True)[0]
#
a = x
ptsX =[]
for crv1 in a:
    pts=[]
    pts = ghcomp.DivideCurve(crv1, segments, True)[0]
    for i in range(5):
        pts.pop(0)
        pts.pop(-1)
    ptsX.append(pts)


b = y
ptsY =[]
for crv2 in b:
    pts=[]
    pts = ghcomp.DivideCurve(crv2, segments, True)[0]
    for i in range(5):
        pts.pop(0)
        pts.pop(-1)
    ptsY.append(pts)

a=ghtree.list_to_tree(x)
ghcomp.GraftTree(a)
ptsX =ghtree.list_to_tree(ptsX)
ghcomp.GraftTree(ptsX)


b=ghtree.list_to_tree(y)
ghcomp.GraftTree(b)
ptsY =ghtree.list_to_tree(ptsY)
ghcomp.GraftTree(ptsY)
# ---------- end python ----------
weave_3 = Weave(Pattern=[0, 1], Stream0=python.ptsX, Stream1=python.ptsY, NullGaps=False)
pline = PolyLine(Vertices=weave_3, Closed=False)
panel = Panel("2")
fillet = Fillet(Curve=pline, Radius=".0025")
division_3 = Division(A=number_slider, B=panel)
pipe = Pipe(Curve=fillet, Radius=expr("x*0.75", division_3), Caps=2)

# ----
pframe_2 = PerpFrame(Curve=reparameterize(graft(intcrv_2.Curve)), Parameter=flatten([subtraction_2, connection_point]))
pframe_3 = PerpFrame(Curve=reparameterize(graft(intcrv.Curve)), Parameter=flatten([subtraction, connection_point]))
midpt = CurveMiddle(Curve=simplify)
midpt_2 = CurveMiddle(Curve=simplify_2)
pt = Point(simplify(pframe_3))
pt_2 = Point(simplify(pframe_2))
split = SplitTree(Data=pt, Masks=flatten("{?}[0]"))  # -> Positive, Negative
split_2 = SplitTree(Data=pt_2, Masks=flatten("{?}[0]"))  # -> Positive, Negative

# ---- group: Joinery / Joinery 2
pt_3 = Point(divide_2.Points)
pt_4 = Point(flatten(split_2.Negative))
pt_5 = Point(split.Negative)
clean = CleanTree(RemoveNulls=True, RemoveInvalid=True, RemoveEmpty=False, Tree=pt_4)
clean_2 = CleanTree(RemoveNulls=True, RemoveInvalid=True, RemoveEmpty=False, Tree=pt_5)  # -> flatten(Tree)
ln_2 = Line(StartPoint=clean, EndPoint=clean_2)
len_2 = Length(Curve=ln_2)
midpt_3 = CurveMiddle(Curve=ln_2)
python_2 = GhPythonScript(x=len_2)  # -> out, n, p; inputs x: list
# ---------- python_2: Python ----------
import ghpythonlib.components as ghcomp

length = x.pop()
n = -1 * (length*2)
p = (length * 2) - length
# ---------- end python_2 ----------
Y_2 = UnitY(Factor=python_2.p)
Y_3 = UnitY(Factor=python_2.n)
move_4 = Move(Geometry=pt_3, Motion=Y_3)  # -> flatten(Geometry), Transform
move_5 = Move(Geometry=pt_3, Motion=Y_2)  # -> flatten(Geometry), Transform
ln_3 = Line(StartPoint=move_4.Geometry, EndPoint=clean_2)
ln_4 = Line(StartPoint=clean, EndPoint=move_5.Geometry)
weave_4 = Weave(
    Pattern=[0, 1, 2, 3],
    Stream0=graft(move_4.Geometry),
    Stream1=graft(clean),
    Stream2=graft(clean_2),
    Stream3=graft(move_5.Geometry),
    NullGaps=False)
pline_2 = PolyLine(Vertices=weave_4, Closed=True)
project = Project(Geometry=pline_2, Plane=PlaneXY(0, 0, 0))  # -> Geometry, Transform
mirror = MirrorCurve(Geometry=project.Geometry, Curve=rail_1, Tangent=True)
loft = Loft(
    Curves=[pline_2, project.Geometry],
    Options={Adjust=False, Closed=False, LoftEnds=0, LoftSimp=0, LoftType=0, Rebuild=10, Refit=0.01})
loft_2 = Loft(
    Curves=[pline_2, mirror],
    Options={Adjust=False, Closed=False, LoftEnds=0, LoftSimp=0, LoftType=0, Rebuild=10, Refit=0.01})
srf = Surface(mirror)
srf_2 = Surface(project.Geometry)

# ---- group: Joinery / Joinery 1
pt_6 = Point(flatten(split_2.Positive))
pt_7 = Point(split.Positive)
pt_8 = Point(divide.Points)
clean_3 = CleanTree(RemoveNulls=True, RemoveInvalid=True, RemoveEmpty=False, Tree=pt_6)
clean_4 = CleanTree(RemoveNulls=True, RemoveInvalid=True, RemoveEmpty=False, Tree=pt_7)  # -> flatten(Tree)
ln_5 = Line(StartPoint=clean_3, EndPoint=clean_4)
midpt_4 = CurveMiddle(Curve=ln_5)
len_3 = Length(Curve=ln_5)
python_3 = GhPythonScript(x=len_3)  # -> out, n, p; inputs x: list; same code as python_2
Y_4 = UnitY(Factor=python_3.p)
Y_5 = UnitY(Factor=python_3.n)
move_6 = Move(Geometry=pt_8, Motion=Y_5)  # -> flatten(Geometry), Transform
move_7 = Move(Geometry=pt_8, Motion=Y_4)  # -> flatten(Geometry), Transform
weave_5 = Weave(
    Pattern=[0, 1, 2, 3],
    Stream0=graft(move_6.Geometry),
    Stream1=graft(clean_3),
    Stream2=graft(clean_4),
    Stream3=graft(move_7.Geometry),
    NullGaps=False)
pline_3 = PolyLine(Vertices=weave_5, Closed=True)
project_2 = Project(Geometry=pline_3, Plane=PlaneXY(0, 0, 0))  # -> Geometry, Transform
mirror_2 = MirrorCurve(Geometry=project_2.Geometry, Curve=rail_2, Tangent=True)
loft_3 = Loft(
    Curves=[pline_3, mirror_2],
    Options={Adjust=False, Closed=False, LoftEnds=0, LoftSimp=0, LoftType=0, Rebuild=10, Refit=0.01})
loft_4 = Loft(
    Curves=[pline_3, project_2.Geometry],
    Options={Adjust=False, Closed=False, LoftEnds=0, LoftSimp=0, LoftType=0, Rebuild=10, Refit=0.01})
srf_3 = Surface(mirror_2)
srf_4 = Surface(project_2.Geometry)

# ---- group: Cross sectional thickness - Top Curve 1
panel_2 = Panel("""0.15
0.85""")
pframe_4 = PerpFrame(Curve=reparameterize(graft(intcrv.Curve)), Parameter=flatten(panel_2))
orient = Orient(Geometry=polygon.Polygon, Source=PlaneXY(0, 0, 0), Target=pframe_4)  # -> simplify(Geometry), Transform
split_3 = SplitTree(Data=simplify(orient.Geometry), Masks=flatten("{?}[0]"))  # -> Positive, Negative
clean_5 = CleanTree(RemoveNulls=True, RemoveInvalid=True, RemoveEmpty=True, Tree=split_3.Negative)
swp1 = Sweep1(Rail=intcrv.Curve, Sections=orient.Geometry, Miter=1)
clean_6 = CleanTree(RemoveNulls=True, RemoveInvalid=True, RemoveEmpty=True, Tree=split_3.Positive)
extr = ExtrudePoint(Base=graft(clean_5), Point=simplify(graft(clean_4)))
extr_2 = ExtrudePoint(Base=graft(clean_6), Point=pt_5)

# ---- group: Cross sectional thickness - Top Curve 2
pframe_5 = PerpFrame(Curve=reparameterize(graft(intcrv_2.Curve)), Parameter=flatten(panel_2))
orient_2 = Orient(Geometry=polygon.Polygon, Source=PlaneXY(0, 0, 0), Target=pframe_5)  # -> simplify(Geometry), Transform
split_4 = SplitTree(Data=simplify(orient_2.Geometry), Masks=flatten("{?}[0]"))  # -> Positive, Negative
swp1_2 = Sweep1(Rail=intcrv_2.Curve, Sections=orient_2.Geometry, Miter=1)
clean_7 = CleanTree(RemoveNulls=True, RemoveInvalid=True, RemoveEmpty=True, Tree=split_4.Positive)
clean_8 = CleanTree(RemoveNulls=True, RemoveInvalid=True, RemoveEmpty=True, Tree=split_4.Negative)
extr_3 = ExtrudePoint(Base=graft(clean_7), Point=graft(clean))
extr_4 = ExtrudePoint(Base=graft(clean_8), Point=graft(clean_3))

# ---- group: Tertiary members
ln_6 = Line(StartPoint=midpt, EndPoint=midpt_2)
division_4 = Division(A=division_3, B=panel)
midpt_5 = CurveMiddle(Curve=ln_6)
weave_6 = Weave(Pattern=[0, 1, 2], Stream0=graft(midpt_4), Stream1=graft(midpt_5), Stream2=graft(midpt_3), NullGaps=False)
intcrv_3 = Interpolate(Vertices=weave_6, Degree=3, Periodic=False, KnotStyle=1)  # -> Curve, Length, Domain
python_4 = GhPythonScript(x=simplify, y=simplify_2, z=intcrv_3.Curve, segments=no_of_tertiary_divisions)  # -> out, a, b, ptsX, ptsY, ptsZ; inputs x: tree of Curve, y: tree of Curve, z: tree of Curve, segments: Int32
# ---------- python_4: Python ----------
import ghpythonlib.components as ghcomp
import ghpythonlib.treehelpers as ghtree
import Rhino.Geometry as rg

x = ghtree.tree_to_list(x)
y = ghtree.tree_to_list(y)
z = ghtree.tree_to_list(z)

a = x
ptsX =[]
for crv1 in a:
    pts=[]
    pts = ghcomp.DivideCurve(crv1, segments, True)[0]
    for i in range(5):
        pts.pop(0)
        pts.pop(-1)
    ptsX.append(pts)


b = y
ptsY =[]
for crv2 in b:
    pts=[]
    pts = ghcomp.DivideCurve(crv2, segments, True)[0]
    for i in range(5):
        pts.pop(0)
        pts.pop(-1)
    ptsY.append(pts)


c = z
ptsZ =[]
for crv3 in c:
    pts=[]
    pts = ghcomp.DivideCurve(crv3, segments, True)[0]
    for i in range(5):
        pts.pop(0)
        pts.pop(-1)
    ptsZ.append(pts)


a=ghtree.list_to_tree(x)
ghcomp.GraftTree(a)
ptsX =ghtree.list_to_tree(ptsX)
ghcomp.GraftTree(ptsX)


b=ghtree.list_to_tree(y)
ghcomp.GraftTree(b)
ptsY =ghtree.list_to_tree(ptsY)
ghcomp.GraftTree(ptsY)


c=ghtree.list_to_tree(z)
ghcomp.GraftTree(c)
ptsZ =ghtree.list_to_tree(ptsZ)
ghcomp.GraftTree(ptsZ)
# ---------- end python_4 ----------
weave_7 = Weave(Pattern=[0, 1], Stream0=python_4.ptsX, Stream1=python_4.ptsY, NullGaps=False)
pline_4 = PolyLine(Vertices=weave_7, Closed=False)
fillet_2 = Fillet(Curve=pline_4, Radius=".0025")
pipe_2 = Pipe(Curve=[fillet_2, intcrv_3.Curve], Radius=division_4, Caps=2)

# ---- group: Primary Truss Cross-section
merge = Merge(Data1=swp1, Data2=extr_2, Data3=extr, Data4=swp1_2, Data5=extr_3, Data6=extr_4)

# ---- group: Main Truss Surface
weave_8 = Weave(Pattern=[0, 1, 2], Stream0=graft(clean_2), Stream1=graft(move.Geometry), Stream2=graft(clean_4), NullGaps=False)
weave_9 = Weave(Pattern=[0, 1, 2], Stream0=graft(clean), Stream1=graft(move_3.Geometry), Stream2=graft(clean_3), NullGaps=False)
intcrv_4 = Interpolate(Vertices=weave_8, Degree=3, Periodic=False, KnotStyle=1)  # -> Curve, Length, Domain
intcrv_5 = Interpolate(Vertices=weave_9, Degree=3, Periodic=False, KnotStyle=1)  # -> Curve, Length, Domain
loft_5 = Loft(
    Curves=[intcrv_4.Curve, intcrv_5.Curve],
    Options={Adjust=False, Closed=False, LoftEnds=0, LoftSimp=0, LoftType=0, Rebuild=10, Refit=0.01})

# ----
ln_7 = Line(StartPoint=move_6.Geometry, EndPoint=clean_4)
ln_8 = Line(StartPoint=move_7.Geometry, EndPoint=clean_3)

# ---- group: Final Geometry
geo = Geometry(loft_5)

# ----
preview = CustomPreview(Geometry=geo, Material=colour)

# ---- group: Base
panel_3 = Panel("""{0}[1]
{0}[-1]""")
relitem2 = RelativeItems(
    TreeA=simplify(flatten(midpt_4)),
    TreeB=simplify(flatten(midpt_3)),
    Offset=graft(panel_3),
    WrapPaths=False,
    WrapItems=False)  # -> ItemA, ItemB
pline_5 = PolyLine(Vertices=clean, Closed=False)
division_5 = Division(A=Slider(0.01, range=0..0.1), B="2")
ln_9 = Line(StartPoint=relitem2.ItemA, EndPoint=relitem2.ItemB)
pline_6 = PolyLine(Vertices=clean_3, Closed=False)
ln_10 = Line(StartPoint=midpt_4, EndPoint=midpt_3)
pipe_3 = Pipe(Curve=[pline_6, ln_10, pline_5, ln_9], Radius=division_5, Caps=0)

# ---- group: C - Joinery / C Joinery 02
ln_11 = Line(StartPoint=move_6.Geometry, EndPoint=move_7.Geometry)
midpt_6 = CurveMiddle(Curve=ln_11)
cir = Circle(Plane=midpt_4, Radius=expr("x*0.8", len_3))  # -> graft(Circle)
cir_2 = Circle(Plane=midpt_6, Radius=expr("x/2", ln_11))  # -> graft(Circle)
loft_6 = Loft(Curves=[cir, cir_2], Options={Adjust=False, Closed=False, LoftEnds=0, LoftSimp=0, LoftType=0, Rebuild=10, Refit=0.01})
cap = CapHoles(Brep=loft_6)

# ---- group: C - Joinery / C Joinery 01
ln_12 = Line(StartPoint=move_4.Geometry, EndPoint=move_5.Geometry)
midpt_7 = CurveMiddle(Curve=ln_12)
cir_3 = Circle(Plane=midpt_3, Radius=expr("x*0.8", len_2))  # -> graft(Circle)
cir_4 = Circle(Plane=midpt_7, Radius=expr("x/2", ln_12))  # -> graft(Circle)
loft_7 = Loft(Curves=[cir_3, cir_4], Options={Adjust=False, Closed=False, LoftEnds=0, LoftSimp=0, LoftType=0, Rebuild=10, Refit=0.01})
cap_2 = CapHoles(Brep=loft_7)

# ---- group: A - Joinery
pipe_4 = Pipe(Curve=[pline_2, pline_3, ln_3, ln_4, ln_7, ln_8], Radius=expr("x*0.7", number_slider), Caps=2)

# ---- group: B - Joinery / Add Sphere to Joinery
sph = Sphere(Base=midpt_4, Radius=expr("x*0.75", len_3))
sph_2 = Sphere(Base=midpt_3, Radius=expr("x*0.75", len_2))

# ---- group: B - Joinery
merge_2 = Merge(Data1=srf_4, Data2=srf_3, Data3=loft_4, Data4=loft_3)
merge_3 = Merge(Data1=srf_2, Data2=srf, Data3=loft, Data4=loft_2)
